# Grasshopper definition 00_install.ghx (Grasshopper 1.0.8)

# ----
# Basic setup
# This will create a new Rhino Python environment named bit2beam_2026
# and trigger the installation required libraries
setup = Python3Script()  # -> out
# ---------- setup: Python ----------
# venv: bit2beam_2026
# r: compas==2.15.1, compas_timber==2.1.1-rc1, antikythera-sdk==0.3.1, timber_design==0.2.0
import compas
import compas_timber
import timber_design
import antikythera

print("======= venv bit2beam_2026 =======")
print(f"compas - {compas.__version__}")
print(f"compas_timber - {compas_timber.__version__}")
print(f"timber_design - {timber_design.__version__}")
print(f"antikythera - {antikythera.__version__}")
# ---------- end setup ----------
panel = Panel(setup)
